# Dynamo graph Beam_by_curve.dyn (Dynamo 2.3.0.5885)

select_face = DSFaceSelection()  # 1 picked in the model
select_model_elements = DSModelElementsSelection()  # 67 picked in the model
curve = Grid.Curve(grid=select_model_elements)
list_create = List.Create(item0=curve)
ZAxis = Vector.ZAxis()
projectInputOnto = Surface.ProjectInputOnto(surface=select_face, geometryToProject=list_create, projectionDirection=ZAxis)
levels = Levels("Niveau 1")
structural_framing_types = StructuralFramingTypes("HEA160")
beamByCurve = StructuralFraming.BeamByCurve(curve=projectInputOnto, level=levels, structuralFramingType=structural_framing_types)
