# Dynamo graph Change_name.dyn (Dynamo 2.3.0.5885)

element_types = ElementTypes("Room")
all_elements_of_type = ElementsOfType(element_type=element_types)
string = StringInput("Nom de la vue")
getParameterValueByName = Element.GetParameterValueByName(element=all_elements_of_type, parameterName=string)
string_2 = StringInput("T_")
string_3 = StringInput("R_")
# note: Remplacer
replace = String.Replace(str=getParameterValueByName, searchFor=string_2, replaceWith=string_3)
setParameterByName = Element.SetParameterByName(element=all_elements_of_type, parameterName=string, value=replace)
