# Dynamo graph Set_parametre.dyn (Dynamo 2.3.0.5885)

categories = Categories("OST_Sheets")
all_elements_of_category = ElementsOfCategory(Category=categories)
string = StringInput("CODE_PROJET")
getParameterValueByName = Element.GetParameterValueByName(element=all_elements_of_category, parameterName=string)
string_2 = StringInput("9166")
setParameterByName = Element.SetParameterByName(element=all_elements_of_category, parameterName=string, value=string_2)
