# Dynamo graph copy_parametre.dyn (Dynamo 2.3.0.5885)

# note: Selection element
categories = Categories("OST_Rooms")
all_elements_of_category = ElementsOfCategory(Category=categories)
# note: Parametre from
string = StringInput("Occupation")
getParameterValueByName = Element.GetParameterValueByName(element=all_elements_of_category, parameterName=string)
watch = Watch(getParameterValueByName)
# note: Parametre to
string_2 = StringInput("ZoneName")
setParameterByName = Element.SetParameterByName(element=all_elements_of_category, parameterName=string_2, value=getParameterValueByName)
